# Grasshopper definition building measurement.gh (Grasshopper 0.9.80)

community_center = Brep([<brep referenced from the Rhino model> x2])
kindergarden = Brep([<brep referenced from the Rhino model> x9])
primary_school = Brep([<brep referenced from the Rhino model> x10])
residential = Brep([<brep referenced from the Rhino model> x956])
sport = Brep(<brep referenced from the Rhino model>)
mikve = Brep(<brep referenced from the Rhino model>)
highshchool = Brep([<brep referenced from the Rhino model> x2])
synagogue = Brep([<brep referenced from the Rhino model> x6])
hospital = Brep([<brep referenced from the Rhino model> x2])
elderly_center = Brep(<brep referenced from the Rhino model>)
police = Brep(<brep referenced from the Rhino model>)
clinic = Brep([<brep referenced from the Rhino model> x4])
calculate_data = CalculateData(C=residential, B=residential, G=residential)  # -> height, area, location
calculate_data_2 = CalculateData(C=kindergarden, B=kindergarden, G=kindergarden)  # -> height, area, location
calculate_data_3 = CalculateData(C=mikve, B=mikve, G=mikve)  # -> height, area, location
calculate_data_4 = CalculateData(C=primary_school, B=primary_school, G=primary_school)  # -> height, area, location
calculate_data_5 = CalculateData(C=synagogue, B=synagogue, G=synagogue)  # -> height, area, location
calculate_data_6 = CalculateData(C=hospital, B=hospital, G=hospital)  # -> height, area, location
calculate_data_7 = CalculateData(C=community_center, B=community_center, G=community_center)  # -> height, area, location
calculate_data_8 = CalculateData(C=highshchool, B=highshchool, G=highshchool)  # -> height, area, location
calculate_data_9 = CalculateData(C=sport, B=sport, G=sport)  # -> height, area, location
calculate_data_10 = CalculateData(C=police, B=police, G=police)  # -> height, area, location
calculate_data_11 = CalculateData(C=elderly_center, B=elderly_center, G=elderly_center)  # -> height, area, location
calculate_data_12 = CalculateData(C=clinic, B=clinic, G=clinic)  # -> height, area, location
panel = Panel(calculate_data.height)
panel_2 = Panel(calculate_data.area)
panel_3 = Panel(calculate_data.location)
panel_4 = Panel(calculate_data_2.height)
panel_5 = Panel(calculate_data_2.area)
panel_6 = Panel(calculate_data_2.location)
panel_7 = Panel(calculate_data_9.height)
panel_8 = Panel(calculate_data_9.area)
panel_9 = Panel(calculate_data_9.location)
panel_10 = Panel(calculate_data_3.height)
panel_11 = Panel(calculate_data_3.area)
panel_12 = Panel(calculate_data_3.location)
panel_13 = Panel(calculate_data_4.height)
panel_14 = Panel(calculate_data_4.area)
panel_15 = Panel(calculate_data_4.location)
panel_16 = Panel(calculate_data_8.height)
panel_17 = Panel(calculate_data_8.area)
panel_18 = Panel(calculate_data_8.location)
panel_19 = Panel(calculate_data_5.height)
panel_20 = Panel(calculate_data_5.area)
panel_21 = Panel(calculate_data_5.location)
panel_22 = Panel(calculate_data_6.height)
panel_23 = Panel(calculate_data_6.area)
panel_24 = Panel(calculate_data_6.location)
panel_25 = Panel(calculate_data_7.height)
panel_26 = Panel(calculate_data_7.area)
panel_27 = Panel(calculate_data_7.location)
panel_28 = Panel(calculate_data_10.height)
panel_29 = Panel(calculate_data_10.area)
panel_30 = Panel(calculate_data_10.location)
panel_31 = Panel(calculate_data_11.height)
panel_32 = Panel(calculate_data_11.area)
panel_33 = Panel(calculate_data_11.location)
panel_34 = Panel(calculate_data_12.height)
panel_35 = Panel(calculate_data_12.area)
panel_36 = Panel(calculate_data_12.location)
project = Project(Geometry=mikve, Plane=PlaneXY(0, 0, 0))  # -> Geometry, Transform
project_2 = Project(Geometry=highshchool, Plane=PlaneXY(0, 0, 0))  # -> Geometry, Transform
project_3 = Project(Geometry=primary_school, Plane=PlaneXY(0, 0, 0))  # -> Geometry, Transform
project_4 = Project(Geometry=hospital, Plane=PlaneXY(0, 0, 0))  # -> Geometry, Transform
project_5 = Project(Geometry=kindergarden, Plane=PlaneXY(0, 0, 0))  # -> Geometry, Transform
project_6 = Project(Geometry=residential, Plane=PlaneXY(0, 0, 0))  # -> Geometry, Transform
project_7 = Project(Geometry=community_center, Plane=PlaneXY(0, 0, 0))  # -> Geometry, Transform
project_8 = Project(Geometry=clinic, Plane=PlaneXY(0, 0, 0))  # -> Geometry, Transform
project_9 = Project(Geometry=synagogue, Plane=PlaneXY(0, 0, 0))  # -> Geometry, Transform
project_10 = Project(Geometry=sport, Plane=PlaneXY(0, 0, 0))  # -> Geometry, Transform
project_11 = Project(Geometry=police, Plane=PlaneXY(0, 0, 0))  # -> Geometry, Transform
project_12 = Project(Geometry=elderly_center, Plane=PlaneXY(0, 0, 0))  # -> Geometry, Transform
debrep = DeconstructBrep(Brep=project.Geometry)  # -> Faces, simplify(Edges), simplify(Vertices)
debrep_2 = DeconstructBrep(Brep=project_2.Geometry)  # -> Faces, simplify(Edges), simplify(Vertices)
debrep_3 = DeconstructBrep(Brep=project_3.Geometry)  # -> Faces, simplify(Edges), simplify(Vertices)
debrep_4 = DeconstructBrep(Brep=project_4.Geometry)  # -> Faces, simplify(Edges), simplify(Vertices)
debrep_5 = DeconstructBrep(Brep=project_5.Geometry)  # -> Faces, simplify(Edges), simplify(Vertices)
debrep_6 = DeconstructBrep(Brep=project_6.Geometry)  # -> Faces, simplify(Edges), simplify(Vertices)
debrep_7 = DeconstructBrep(Brep=project_7.Geometry)  # -> Faces, simplify(Edges), simplify(Vertices)
debrep_8 = DeconstructBrep(Brep=project_8.Geometry)  # -> Faces, simplify(Edges), simplify(Vertices)
debrep_9 = DeconstructBrep(Brep=project_9.Geometry)  # -> Faces, simplify(Edges), simplify(Vertices)
debrep_10 = DeconstructBrep(Brep=project_10.Geometry)  # -> Faces, simplify(Edges), simplify(Vertices)
debrep_11 = DeconstructBrep(Brep=project_11.Geometry)  # -> Faces, simplify(Edges), simplify(Vertices)
debrep_12 = DeconstructBrep(Brep=project_12.Geometry)  # -> Faces, simplify(Edges), simplify(Vertices)
end = EndPoints(Curve=debrep.Edges)  # -> Start, End
end_2 = EndPoints(Curve=debrep_2.Edges)  # -> Start, End
end_3 = EndPoints(Curve=debrep_3.Edges)  # -> Start, End
end_4 = EndPoints(Curve=debrep_4.Edges)  # -> Start, End
end_5 = EndPoints(Curve=debrep_5.Edges)  # -> Start, End
end_6 = EndPoints(Curve=debrep_6.Edges)  # -> Start, End
end_7 = EndPoints(Curve=debrep_7.Edges)  # -> Start, End
end_8 = EndPoints(Curve=debrep_8.Edges)  # -> Start, End
end_9 = EndPoints(Curve=debrep_9.Edges)  # -> Start, End
end_10 = EndPoints(Curve=debrep_10.Edges)  # -> Start, End
end_11 = EndPoints(Curve=debrep_11.Edges)  # -> Start, End
end_12 = EndPoints(Curve=debrep_12.Edges)  # -> Start, End
panel_37 = Panel(end_6.Start)
panel_38 = Panel(end_6.End)
panel_39 = Panel(end_5.Start)
panel_40 = Panel(end_5.End)
panel_41 = Panel(end_10.Start)
panel_42 = Panel(end_10.End)
panel_43 = Panel(end.Start)
panel_44 = Panel(end.End)
panel_45 = Panel(end_3.Start)
panel_46 = Panel(end_3.End)
panel_47 = Panel(end_2.Start)
panel_48 = Panel(end_2.End)
panel_49 = Panel(end_9.Start)
panel_50 = Panel(end_9.End)
panel_51 = Panel(end_4.Start)
panel_52 = Panel(end_4.End)
panel_53 = Panel(end_7.Start)
panel_54 = Panel(end_7.End)
panel_55 = Panel(end_11.Start)
panel_56 = Panel(end_11.End)
panel_57 = Panel(end_12.Start)
panel_58 = Panel(end_12.End)
panel_59 = Panel(end_8.End)
panel_60 = Panel(end_8.Start)

# ==== cluster CalculateData
G = ClusterInput()
B = ClusterInput()
C = ClusterInput()
project = Project(Geometry=G, Plane=PlaneXY(0, 0, 0))  # -> Geometry, Transform
edges = BrepEdges(Brep=B)  # -> Naked, Interior, NonManifold
bbox = BoundingBox(Content=C, Plane=PlaneXY(0, 0, 0))  # -> Box, Box_2
Z = UnitZ(Factor=1)
box = EvaluateBox(Box=bbox.Box, UParameter=0.5, VParameter=0.5, WParameter=0.5)  # -> Plane, Point, Include
line = LineSDL(Start=box.Point, Direction=Z, Length=Slider(100, range=0..100))
split = SplitWithBreps(Curve=line, Brep=bbox.Box)  # -> Curve, Points
item = ListItem(List=split.Curve, Index=0, Wrap=True)
len = Length(Curve=item)
building_height = Multiplication(A=len, B=2)  # -> flatten(Result)
building_area = Area(Geometry=project.Geometry)  # -> Area, Centroid
area = ClusterOutput(building_area.Area)
location = ClusterOutput(building_area.Centroid)
height = ClusterOutput(building_height)
